# Grasshopper definition importText.gh (Grasshopper 1.0.7)

path = FilePath("/Users/sambennett/Documents/Processing/textOutput/testv1.txt")
file = ReadFile(File=path, PerLineParse=True)
panel = Panel(file)
devec = DeconstructVector(Vector=file)  # -> XComponent, YComponent, ZComponent
pt = ConstructPoint(XCoordinate=devec.XComponent, YCoordinate=devec.YComponent, ZCoordinate=devec.ZComponent)
