# Grasshopper definition importText.gh (Grasshopper 1.0.7)

panel = Panel("""0.0, 0.0, 125.0
-0.70279694, 11.102966, 143.73183
16.155106, 19.343475, 135.32784
22.646484, 17.970238, 123.04239
34.179382, 34.32263, 120.87928
38.42238, 29.04927, 109.24797
66.19322, 27.300285, 106.9307
66.772, 25.865662, 96.461174
85.40082, 19.90615, 99.96867
100.868866, 24.750626, 85.861115
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""")
panel_2 = Panel("""0.0, 0.0, 125.0
-0.70279694, 11.102966, 143.73183
16.155106, 19.343475, 135.32784
22.646484, 17.970238, 123.04239
34.179382, 34.32263, 120.87928
38.42238, 29.04927, 109.24797
66.19322, 27.300285, 106.9307
66.772, 25.865662, 96.461174
85.40082, 19.90615, 99.96867
100.868866, 24.750626, 85.861115
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""")
path = FilePath("/Users/awdriggs/code/pgh/test/testv1.txt")
read_file = ReadFile(PerLineParse=True)
file = ReadFile(File=path, PerLineParse=True)
number_slider = Slider(0.25, range=0..1)
panel_3 = Panel(file)
devec = DeconstructVector(Vector=panel)  # -> XComponent, YComponent, ZComponent
devec_2 = DeconstructVector(Vector=panel_2)  # -> XComponent, YComponent, ZComponent
rectangle = Rectangle(Plane=PlaneXY(0, 0, 0), XSize="100", YSize="5", Radius=0)  # -> Rectangle, Length
pt = ConstructPoint(XCoordinate=devec.XComponent, YCoordinate=devec.YComponent, ZCoordinate=devec.ZComponent)
box_rectangle = BoxRectangle(Rectangle=rectangle.Rectangle, Height="100")
pt_2 = ConstructPoint(XCoordinate=devec_2.XComponent, YCoordinate=devec_2.YComponent, ZCoordinate=devec_2.ZComponent)
nurbs_curve = NurbsCurve(Vertices=pt, Degree="2", Periodic=False)  # -> Curve, Length, Domain
nurbs_curve_2 = NurbsCurve(Vertices=pt_2, Degree="2", Periodic=False)  # -> Curve, Length, Domain
bounding_box = BoundingBox(Content=nurbs_curve.Curve, Plane=PlaneXY(0, 0, 0))  # -> Box, Box_2
box_mapping = BoxMapping(Geometry=nurbs_curve.Curve, Source=bounding_box.Box, Target=box_rectangle)  # -> Geometry, Transform
scale = Scale(Geometry=nurbs_curve_2.Curve, Center=Point(0, 0, 0), Factor=0.5)  # -> Geometry, Transform
unit_y = UnitY(Factor=Slider(0.149, range=0.01..1))
scale_nu = ScaleNU(Geometry=scale.Geometry, Plane=PlaneXY(0, 0, 0), ScaleX=1, ScaleY=unit_y, ScaleZ=1)  # -> Geometry, Transform
pipe = Pipe(Curve=box_mapping.Geometry, Radius="1", Caps=0)
pipe_2 = Pipe(Curve=scale_nu.Geometry, Radius="1", Caps=0)
cap_holes = CapHoles(Brep=pipe_2)
cap_holes_2 = CapHoles(Brep=pipe)
bounding_box_2 = BoundingBox(Content=pipe_2, Plane=PlaneXY(0, 0, 0))  # -> Box, Box_2
